# Grasshopper definition SpacePartition.gh (Grasshopper 1.0.7)
# plug-ins: FloorsAndVolumes, PTComponentLibrary

number_slider = Slider(9, range=0..10)
number_slider_2 = Slider(4, range=0..5)

# ---- group: NumberOfPoints
number_slider_3 = Slider(6, range=0..10)

# ----
dom = ConstructDomain(DomainStart=expr("-x", 0), DomainEnd=1)
dom_2 = ConstructDomain(DomainStart=expr("-x", number_slider), DomainEnd=number_slider)
dom_3 = ConstructDomain(DomainStart=expr("-x", number_slider_2), DomainEnd=number_slider_2)
genemodifier = GenePoolModifier(GeneList="SeedsX", Count=number_slider_3, Domain=dom)
genemodifier_2 = GenePoolModifier(GeneList="SeedsY", Count=number_slider_3, Domain=dom)
rectangle = Rectangle(Plane=PlaneXY(0, 0, 0), XSize=dom_3, YSize=dom_2, Radius=0)  # -> Rectangle, Length
seedsy = GenePool(Decimals=2, Maximum=1, Minimum=0, Value=[0.07659977585, 0.9160641157, 0.898054799, 0.5309384728, 0.08528135209, 0.39])
seedsx = GenePool(Decimals=2, Maximum=1, Minimum=0, Value=[0.8980774688, 0.1529094419, 0.9080840032, 0.4803980801, 0.1686172365, 0.37])
crv = Curve(rectangle.Rectangle)
pt = ConstructPoint(XCoordinate=seedsx, YCoordinate=seedsy, ZCoordinate=0)
ptsrfdomlen = SurfaceDomainLength(Surface=crv, ULength=Slider(2, range=0..5), VLength=Slider(3, range=0..5))
evalsrf = EvaluateSurface(Surface=reparameterize(crv), Point=pt)  # -> Point, Normal, UDirection, VDirection, Frame
pt_2 = Point(evalsrf.Point)
ptborders = GenerateBorders(Grid=ptsrfdomlen, PanelShape=0)  # -> simplify(Border)
voronoi = Voronoi(Points=pt_2, Boundary=crv, BruteForceOverride=False)
crv_2 = Curve(flatten(ptborders))
list_item = ListItem(List=crv_2, Index=0, Wrap=True)
area = Area(Geometry=list_item, UseTasks=False)  # -> Area, Centroid
multiplication = Multiplication(A=area.Area, B=Slider(0.5, range=0..1))
c_script = CSharpScript(voronoiIn=voronoi, gridIn=crv_2, areaIn=multiplication)  # -> culledGrid, colourTree; inputs voronoiIn: list of Polyline, gridIn: list of Polyline, areaIn: Double
# ---------- c_script: C# usings ----------
using System.Linq;
# ---------- c_script: C# ----------
    var intersections = new DataTree<Curve>();
    var repeated = new DataTree<Polyline>();
    var bools = new DataTree<bool>();

    for( int i = 0; i < voronoiIn.Count; ++i )
    {

      repeated.AddRange(gridIn, new GH_Path(i));

      for( int j = 0; j < gridIn.Count; ++j )
      {

        intersections.AddRange(Curve.CreateBooleanIntersection(voronoiIn[i].ToNurbsCurve(), gridIn[j].ToNurbsCurve(), 1e-7).ToList(), new GH_Path(i, j));

      }

    }

    for( int i = 0; i < intersections.BranchCount; ++i )
    {

      var tempList = intersections.Branch(i);
      var path = new GH_Path(intersections.Path(i).Indices[0]);
      bool temp = false;

      if( tempList.Count > 0 )
      {

        temp = AreaMassProperties.Compute(intersections.Branch(i)[0]).Area < areaIn ? false : true;

        bools.Add(temp, path);

      }

      else
      {

        temp = false;
        bools.Add(temp, path);

      }

    }

    var treeOut = new DataTree<Polyline>();
    var coloursOut = new DataTree<System.Drawing.Color>();
    var rand = new Random();
    var col = System.Drawing.Color.FromArgb(255, 180, 100, 100);

    for( int i = 0; i < bools.BranchCount; ++i )
    {

      var path = repeated.Path(i);

      coloursOut.Add(System.Drawing.Color.FromArgb(255, rand.Next(0, 255), rand.Next(0, 255), rand.Next(0, 255)), path);

      for( int j = 0; j < bools.Branch(i).Count; ++j )
      {

        if( bools.Branch(i)[j] == true )
        {

          treeOut.Add(repeated.Branch(i)[j], path);

        }

      }

    }

    culledGrid = treeOut;
    colourTree = coloursOut;
# ---------- end c_script ----------
surface = Surface(c_script.culledGrid)
flatten_tree = FlattenTree(Tree=surface, Path="{0}")
list_length = ListLength(List=flatten_tree)
list_length_2 = ListLength(List=crv_2)
custom_preview = CustomPreview(Geometry=surface, Material=c_script.colourTree)
expression = Expression(x=list_length_2, y=list_length, Expression="If( x ≠ y, False, True )")
panel = Panel(expression)
